# Grasshopper definition zero.gh (Grasshopper 1.0.4)

brep = Brep([<brep referenced from the Rhino model> x22])
brep_2 = Brep([<brep referenced from the Rhino model> x2])
brep_3 = Brep([<brep referenced from the Rhino model> x2])
brep_4 = Brep([<brep referenced from the Rhino model> x4])
pr = PRISM(name="prism", type="FLUID", breps=brep_3)  # -> out, a, pts, Height; inputs breps: list of Brep
# ---------- pr: Python ----------
__author__ = "zhaorenfan"
__version__ = "2022.09.03"

ghenv.Component.Name = "PRISM"
ghenv.Component.NickName = "pr"
ghenv.Component.Message = "VER 0.0.1\nSept_3_2022"
ghenv.Component.Category = "ZRF"
ghenv.Component.SubCategory = "0 | ZRF"

import rhinoscriptsyntax as rs
import Rhino as rc
import ghpythonlib.components as gh




pts = []
a = []
Height = []
if len(name)==0:
    name = "prism"
if len(type) == 0:
    type = "FLUID"

i = 1
print(len(breps))
for brep in breps:
    F, E, V = gh.DeconstructBrep(brep)
    tri1 = ""
    tri2 = ""
    numOfTri = 0
    for f in F:
        print(f)
        if rs.IsSurfaceTrimmed(f):
            if tri1=="":
                tri1 = f
            else:
                tri2 = f
            numOfTri += 1
    print(numOfTri)
    print(tri1)
    print(tri2)
    _, _, Pts1 = gh.DeconstructBrep(tri1)
    for p in Pts1:
        pts.append(p)
    _, _, Pts2 = gh.DeconstructBrep(tri2)
    p1 = Pts1[0]
    p2 = ""
    for p in Pts2:
        n1 = 0
        n2 = 0
        for x in range(3):
            p1x = p1[x]
            p2x = p[x]
            if p1x==p2x:
                n1+=1
            else:
                n2+=1
        if n1 == 2 and n2 ==1:
            p2 = p
            pts.append(p2)
            break
    print(p1)
    print(p2)
    d = rs.VectorSubtract(p2, p1)
    print(d)
    h = d[0]+d[1]+d[2]
    Height.append(h)
    
    # PRISM prism.1 FLUID VERT1 {-4,3,0} VERT2 {0,3,6} VERT3 {0,3,6} HEIGHT 1
    v = "PRISM "+name+"."+str(i)+" "+type
    i+=1
    v+=" VERT1 {"+str(Pts1[0])+"} "+"VERT2 {"+str(Pts1[1])+"}"+" VERT2 {"+str(Pts1[2])+"}"
    v+=" HEIGHT "+str(h)
    a.append(v)
# ---------- end pr ----------
w = WALL(name="wall", surfs=brep)  # -> out, a, pts; inputs surfs: list of Surface
# ---------- w: Python ----------
__author__ = "zhaorenfan"
__version__ = "2022.09.02"

ghenv.Component.Name = "WALL"
ghenv.Component.NickName = "w"
ghenv.Component.Message = "VER 0.0.1\nJULY_2_2022"
ghenv.Component.Category = "ZRF"
ghenv.Component.SubCategory = "0 | ZRF"

import rhinoscriptsyntax as rs
import Rhino as rc
import ghpythonlib.components as gh

if len(name)==0:
    name="wall"
a = []
pts = []
i = 1
for surf in surfs:
    _, _, Vt = gh.DeconstructBrep(surf)
    # print(Vt)
    p1 = Vt[0]
    
    xmin = p1[0]
    ymin = p1[1]
    zmin = p1[2]
    xmax = p1[0]
    ymax = p1[1]
    zmax = p1[2]
    for p in Vt:
        xmin = min(xmin, p[0])
        ymin = min(ymin, p[1])
        zmin = min(zmin, p[2])
        xmax = max(xmax, p[0])
        ymax = max(ymax, p[1])
        zmax = max(zmax, p[2])
    pmin = rc.Geometry.Point3d(xmin,ymin,zmin)
    pmax = rc.Geometry.Point3d(xmax,ymax,zmax)
    pts.append(pmin)
    pts.append(pmax)
    
    v = "WALL "+name+"."+str(i)
    i += 1
    v+=" PSTART {"+str(pmin)+"} "+"PEND {"+str(pmax)+"}"
    a.append(v)
# ---------- end w ----------
blk = BLOCK(name="block", type="FLUID", breps=brep_4)  # -> out, a, V; inputs breps: list of Brep
# ---------- blk: Python ----------
__author__ = "zhaorenfan"
__version__ = "2022.09.02"

ghenv.Component.Name = "BLOCK"
ghenv.Component.NickName = "blk"
ghenv.Component.Message = "VER 0.0.1\nJULY_2_2022"
ghenv.Component.Category = "ZRF"
ghenv.Component.SubCategory = "0 | ZRF"

import rhinoscriptsyntax as rs
import Rhino as rc
import ghpythonlib.components as gh

def findPoints(Vertex):
    print(Vertex)
    xmin = Vertex[0][0]
    ymin = Vertex[0][1]
    zmin = Vertex[0][2]
    xmax = Vertex[0][0]
    ymax = Vertex[0][1]
    zmax = Vertex[0][2]
    for v in Vertex:
        xmin = min(xmin, v[0])
        ymin = min(ymin, v[1])
        zmin = min(zmin, v[2])
        
        xmax = max(xmax, v[0])
        ymax = max(ymax, v[1])
        zmax = max(zmax, v[2])
    pmin = rc.Geometry.Point3d(xmin,ymin,zmin)
    pmax = rc.Geometry.Point3d(xmax,ymax,zmax)
    return pmin, pmax


V = []
a = []
if len(name)==0:
    name = "block"
if len(type) == 0:
    type = "FLUID"

i = 1
print(len(breps))
for brep in breps:
    _, _, Vt = gh.DeconstructBrep(brep)
    print(brep)
    v = "BLOCK "+name+"."+str(i)+" "+type
    i+=1
    p1, p2 = findPoints(Vt)
    v+=" PSTART {"+str(p1)+"} "+"PEND {"+str(p2)+"}"
    a.append(v)
    
    for vertex in Vt:
        p = rc.Geometry.Point3d(vertex)
        V.append(p)
# ---------- end blk ----------
o = OPENING(name="opening", surfs=brep_2)  # -> out, a, pts; inputs surfs: list of Surface
# ---------- o: Python ----------
"""Provides a scripting component.
    Inputs:
        name: opening的名字
        surfs: opening的brep类型的表面
    Output:
        a: 输出自定义的文本
        pts: 参考点
"""

__author__ = "zhaorenfan"
__version__ = "2022.09.02"

ghenv.Component.Name = "OPENING"
ghenv.Component.NickName = "o"
ghenv.Component.Message = "VER 0.0.1\nJULY_2_2022"
ghenv.Component.Category = "ZRF"
ghenv.Component.SubCategory = "0 | ZRF"

import rhinoscriptsyntax as rs
import Rhino as rc
import ghpythonlib.components as gh

if len(name)==0:
    name="opening"
a = []
pts = []
i = 1
for surf in surfs:
    _, _, Vt = gh.DeconstructBrep(surf)
    # print(Vt)
    p1 = Vt[0]
    
    xmin = p1[0]
    ymin = p1[1]
    zmin = p1[2]
    xmax = p1[0]
    ymax = p1[1]
    zmax = p1[2]
    for p in Vt:
        xmin = min(xmin, p[0])
        ymin = min(ymin, p[1])
        zmin = min(zmin, p[2])
        xmax = max(xmax, p[0])
        ymax = max(ymax, p[1])
        zmax = max(zmax, p[2])
    pmin = rc.Geometry.Point3d(xmin,ymin,zmin)
    pmax = rc.Geometry.Point3d(xmax,ymax,zmax)
    pts.append(pmin)
    pts.append(pmax)
    
    v = "OPENING "+name+"."+str(i)
    i += 1
    v+=" PSTART {"+str(pmin)+"} "+"PEND {"+str(pmax)+"}"
    a.append(v)
# ---------- end o ----------
panel = Panel(pr.a)
panel_2 = Panel(blk.a)
panel_3 = Panel(w.a)
panel_4 = Panel(o.a)
merge = Merge(Data1="DOMAIN room.1", Data2=panel_2, Data3=panel_3, Data4=panel_4, Data5=panel)
panel_5 = Panel(merge)
